# Dynamo graph Extract_Materials.dyn (Dynamo 2.16.4.10216)

string = StringInput("C:\Users\SRIVALLI\Desktop\Data.xlsx")
string_2 = StringInput("Extract materiial ")
number_slider = DoubleSlider(0, range=0..100 step 0.1)
number_slider_2 = DoubleSlider(0, range=0..100 step 0.1)
categories = Categories("OST_Walls")
all_elements_of_category = ElementsOfCategory(Category=categories)
categories_2 = Categories("OST_Floors")
all_elements_of_category_2 = ElementsOfCategory(Category=categories_2)
categories_3 = Categories("OST_StructuralColumns")
all_elements_of_category_3 = ElementsOfCategory(Category=categories_3)
categories_4 = Categories("OST_StructuralFraming")
all_elements_of_category_4 = ElementsOfCategory(Category=categories_4)
categories_5 = Categories("OST_Rebar")
all_elements_of_category_5 = ElementsOfCategory(Category=categories_5)
categories_6 = Categories("OST_Doors")
all_elements_of_category_6 = ElementsOfCategory(Category=categories_6)
categories_7 = Categories("OST_Windows")
all_elements_of_category_7 = ElementsOfCategory(Category=categories_7)
list_create = List.Create(item0=all_elements_of_category, item1=all_elements_of_category_2, item2=all_elements_of_category_3, item3=all_elements_of_category_4, item4=all_elements_of_category_5, item5=all_elements_of_category_6, item6=all_elements_of_category_7)
flatten = List.Flatten(list=list_create)
python_script = Python(IN[0]=flatten)  # CPython3
# ---------- python_script.python (222 lines) ----------
import clr

# Revit references
clr.AddReference('RevitServices')
from RevitServices.Persistence import DocumentManager

clr.AddReference('RevitAPI')
from Autodesk.Revit.DB import *

doc = DocumentManager.Instance.CurrentDBDocument
elements = UnwrapElement(IN[0])

data = {}

# 🔹 STRUCTURAL MATERIAL
def get_structural_material(el):
    try:
        p = el.LookupParameter("Structural Material")
        if p and p.HasValue:
            return doc.GetElement(p.AsElementId())
    except:
        pass
    return None

# 🔹 DENSITY (Revit first, then default if missing)
def get_density(mat):
    try:
        pse = doc.GetElement(mat.StructuralAssetId)
        if pse:
            asset = pse.GetStructuralAsset()
            if asset and asset.Density > 0:
                return asset.Density * 35.3147  # convert to kg/m3
    except:
        pass

    name = mat.Name.lower()

    if "concrete" in name:
        return 2400
    elif "brick" in name:
        return 1800
    elif "steel" in name or "metal" in name:
        return 7850
    elif "plaster" in name or "gypsum" in name:
        return 1200
    elif "insulation" in name:
        return 50
    elif "sand" in name:
        return 1600
    elif "hard" in name:
        return 2200
    else:
        return 1000

# =====================================================
# 🔹 MAIN LOOP
# =====================================================
for el in elements:
    try:
        cat = el.Category.Name
        cat_lower = cat.lower()

        total_vol = 0
        try:
            p = el.LookupParameter("Volume")
            if p:
                total_vol = p.AsDouble() * 0.0283168  # m3
        except:
            pass

        # -------------------------------
        # WALLS / FLOORS / ROOFS
        # -------------------------------
        if any(x in cat_lower for x in ["wall", "floor", "roof"]):
            try:
                type_elem = None

                if "wall" in cat_lower:
                    type_elem = el.WallType
                elif "floor" in cat_lower:
                    type_elem = el.FloorType
                elif "roof" in cat_lower:
                    type_elem = el.RoofType

                cs = type_elem.GetCompoundStructure()

                if cs:
                    layers = cs.GetLayers()
                    total_thickness = sum([l.Width for l in layers if l.Width > 0])

                    for layer in layers:
                        mat_id = layer.MaterialId
                        if mat_id == ElementId.InvalidElementId:
                            continue

                        mat = doc.GetElement(mat_id)
                        name = mat.Name

                        frac = layer.Width / total_thickness if total_thickness > 0 else 0
                        vol_m3 = total_vol * frac

                        density = get_density(mat)
                        mass = vol_m3 * density

                        key = cat + "|" + name

                        if key in data:
                            data[key]["volume"] += vol_m3
                            data[key]["mass"] += mass
                        else:
                            data[key] = {
                                "category": cat,
                                "material": name,
                                "volume": vol_m3,
                                "density": density,
                                "mass": mass,
                                "count": "",
                                "volume_unit": "m3",
                                "density_unit": "kg/m3",
                                "mass_unit": "kg"
                            }

            except:
                pass

        # -------------------------------
        # STRUCTURAL
        # -------------------------------
        elif any(x in cat_lower for x in ["column", "framing", "beam"]):
            mat_ids = []

            struct_mat = get_structural_material(el)
            if struct_mat:
                mat_ids = [struct_mat.Id]

            if not mat_ids:
                mat_ids = el.GetMaterialIds(True)

            if not mat_ids:
                mat_ids = el.GetMaterialIds(False)

            for mid in mat_ids:
                mat = doc.GetElement(mid)
                name = mat.Name

                vol_m3 = total_vol
                density = get_density(mat)
                mass = vol_m3 * density

                key = cat + "|" + name

                data[key] = {
                    "category": cat,
                    "material": name,
                    "volume": vol_m3,
                    "density": density,
                    "mass": mass,
                    "count": "",
                    "volume_unit": "m3",
                    "density_unit": "kg/m3",
                    "mass_unit": "kg"
                }

        # -------------------------------
        # DOORS / WINDOWS
        # -------------------------------
        elif "door" in cat_lower or "window" in cat_lower:
            key = cat + "|Assembly"

            if key in data:
                data[key]["count"] += 1
            else:
                data[key] = {
                    "category": cat,
                    "material": "Assembly",
                    "volume": 0,
                    "density": 0,
                    "mass": 0,
                    "count": 1,
                    "volume_unit": "-",
                    "density_unit": "-",
                    "mass_unit": "-"
                }

    except:
        pass

# =====================================================
# 🔹 OUTPUT
# =====================================================
categories = []
materials = []
volumes = []
volume_units = []
densities = []
density_units = []
masses = []
mass_units = []
counts = []

for v in data.values():
    categories.append(v["category"])
    materials.append(v["material"])
    volumes.append(round(v["volume"], 3))
    volume_units.append(v["volume_unit"])
    densities.append(round(v["density"], 2) if isinstance(v["density"], (int, float)) else v["density"])
    density_units.append(v["density_unit"])
    masses.append(round(v["mass"], 2) if isinstance(v["mass"], (int, float)) else v["mass"])
    mass_units.append(v["mass_unit"])
    counts.append(v["count"])

OUT = (
    categories,
    materials,
    volumes,
    volume_units,
    densities,
    density_units,
    masses,
    mass_units,
    counts
)
# ----------------------------------------
transpose = List.Transpose(lists=python_script)
code_block = CodeBlock { ["Category","Material","Volume","Volume Unit","Density","Density Unit","Mass","Mass Unit","Count"]; }
number_slider_3 = DoubleSlider(0, range=0..100 step 0.1)
insert = List.Insert(list=transpose, element=code_block, index=number_slider_3)
boolean = BoolSelector(true)
boolean_2 = BoolSelector(false)
exportToExcel = Data.ExportToExcel(filePath=string, sheetName=string_2, startRow=number_slider, startColumn=number_slider_2, data=insert, overWrite=boolean, writeAsString=boolean_2)
watch = Watch(python_script)
